# Dynamo graph RibbonModify.dyn (Dynamo 2.0.1.5055)

# group: Input
# note: For selection and whatnot

# group: Background
# note: For workflow

# group: Control
# note: For sliders and other options

# group: To Revit
# note: For changes made to Revit

# group: Annotation
# note: For notes and titles

# group: Info
# note: For general Information

# group: Other
# note: For general other needs

number_slider = DoubleSlider(3.4, range=0..100 step 0.1)
# note: **Rhythm v.2018.9.19
rotate = Rhythm.Revit.Ribbon.Modifiers.Rotate(rotation=number_slider)
setColor = Rhythm.Revit.Ribbon.Modifiers.SetColor()  # unwired: color
setFont = Rhythm.Revit.Ribbon.Modifiers.SetFont()  # unwired: fontName
